# Grasshopper definition TestGraph.gh (Grasshopper 1.0.8)
# plug-ins: jSwan, Karamba3D, Human, Glab

# ----
# Node with custorm attribute
panel = Panel("NodeAttribute")
point = Point(<point referenced from the Rhino model>)
serialize_keys_and_values = SerializeKeysAndValues(Key="KeyNode", Value=panel)
construct_node = ConstructNode(Points=point, Attributes=serialize_keys_and_values)
deconstruct_node = DeconstructNode(Node=construct_node)  # -> Properties, Point, LinkedObjects, Attributes
panel_2 = Panel(deconstruct_node.Attributes)
panel_3 = Panel(deconstruct_node.Properties)

# ----
# Create a graph from node and edge
curve = Curve([<curve referenced from the Rhino model> x3])
serialize_keys_and_values_2 = SerializeKeysAndValues(Key="EdgeKey", Value="EdgeAttribute")
construct_edge = ConstructEdge(Curves=curve, Attributes=serialize_keys_and_values_2)
construct_graph = ConstructGraph(Nodes=construct_node, Edges=construct_edge, ShatterEdge=True)  # -> Graphs, IsolatedNodes, IsolatedEdges
deconstruct_graph = DeconstructGraph(Graph=construct_graph.Graphs)  # -> Properties, Nodes, Edges, Attributes
serialize_keys_and_values_3 = SerializeKeysAndValues(Key="KeyTest", Value="ValueTest")
panel_4 = Panel(deconstruct_graph.Properties)
longest_list = LongestList(ListListA=construct_graph.Graphs, ListListB=serialize_keys_and_values_3, PaddingMode=2)  # -> ListListA, ListListB
modifygraphelement = ModifyGraphElement(Graph=longest_list.ListListA, Attributes=longest_list.ListListB)

# ----
# Create simple graph
point_2 = Point(<point referenced from the Rhino model>)
point_3 = Point(<point referenced from the Rhino model>)
point_4 = Point(<point referenced from the Rhino model>)
point_5 = Point(<point referenced from the Rhino model>)
construct_node_2 = ConstructNode(Points=point_3)
construct_node_3 = ConstructNode(Points=point_4)
construct_node_4 = ConstructNode(Points=point_5)
construct_node_5 = ConstructNode(Points=point_2)
merge = Merge(Data2=construct_node_2, Data3=construct_node_3, Data4=construct_node_4)
longest_list_2 = LongestList(ListListA=construct_node_5, ListListB=merge, PaddingMode=2)  # -> ListListA, ListListB
construct_edge_from_nodes = ConstructEdgeFromNodes(SourceNodes=longest_list_2.ListListA, TargetNodes=longest_list_2.ListListB)
construct_graph_2 = ConstructGraph(Edges=construct_edge_from_nodes, ShatterEdge=True)  # -> Graphs, IsolatedNodes, IsolatedEdges

curve_2 = Curve([<curve referenced from the Rhino model> x2])
curve_3 = Curve(<curve referenced from the Rhino model>)
point_6 = Point(<point referenced from the Rhino model>)

# ----
# Create graph with linked object
point_7 = Point(<point referenced from the Rhino model>)
brep = Brep(<brep referenced from the Rhino model>)
curve_4 = Curve(<curve referenced from the Rhino model>)
brep_2 = Brep(<brep referenced from the Rhino model>)
curve_5 = Curve(<curve referenced from the Rhino model>)
brep_3 = Brep(<brep referenced from the Rhino model>)
construct_node_6 = ConstructNode(Points=point_7, LinkedObjects=brep)
construct_edge_2 = ConstructEdge(Curves=curve_5, LinkedObjects=brep_3)
construct_edge_3 = ConstructEdge(Curves=curve_4, LinkedObjects=brep_2)
construct_graph_3 = ConstructGraph(Nodes=construct_node_6, Edges=[construct_edge_3, construct_edge_2], ShatterEdge=True)  # -> Graphs, IsolatedNodes, IsolatedEdges
deconstruct_graph_2 = DeconstructGraph(Graph=construct_graph_3.Graphs)  # -> Properties, Nodes, Edges, Attributes
deconstruct_node_2 = DeconstructNode(Node=deconstruct_graph_2.Nodes)  # -> Properties, Point, LinkedObjects, Attributes
deconstruct_edge = DeconstructEdge(Edge=deconstruct_graph_2.Edges)  # -> Properties, SourceNode, TargetNode, Geometry, LinkedObjects, Attributes

# ----
# Create multiple graph
point_8 = Point(<point referenced from the Rhino model>)
curve_6 = Curve([<curve referenced from the Rhino model> x5])
construct_edge_4 = ConstructEdge(Curves=curve_6)
construct_node_7 = ConstructNode(Points=point_8)
construct_graph_4 = ConstructGraph(Nodes=construct_node_7, Edges=construct_edge_4, ShatterEdge=True)  # -> Graphs, IsolatedNodes, IsolatedEdges
panel_5 = Panel(construct_graph_4.IsolatedNodes)
panel_6 = Panel(construct_graph_4.IsolatedEdges)

construct_node_8 = ConstructNode(Points=point_6)
construct_edge_5 = ConstructEdge(Curves=curve_3)
construct_edge_6 = ConstructEdge(Curves=curve_2)
construct_graph_5 = ConstructGraph(Edges=construct_edge_6, ShatterEdge=True)  # -> Graphs, IsolatedNodes, IsolatedEdges
construct_graph_6 = ConstructGraph(Nodes=construct_node_8, Edges=construct_edge_5, ShatterEdge=True)  # -> Graphs, IsolatedNodes, IsolatedEdges

# ----
# Connect node to graph
point_9 = Point([<point referenced from the Rhino model> x2])
serialize_keys_and_values_4 = SerializeKeysAndValues(Key="Test", Value="Test")
construct_node_9 = ConstructNode(Points=point_9, Attributes=serialize_keys_and_values_4)
connect_node_to_graph = ConnectNodeToGraph(Graphs=construct_graph_6.Graphs, Nodes=construct_node_9)
deconstruct_graph_3 = DeconstructGraph(Graph=connect_node_to_graph)  # -> Properties, Nodes, Edges, Attributes
deconstruct_node_3 = DeconstructNode(Node=deconstruct_graph_3.Nodes)  # -> Properties, Point, LinkedObjects, Attributes
panel_7 = Panel(deconstruct_graph_3.Properties)
panel_8 = Panel(deconstruct_node_3.Properties)

visualize_graph = VisualizeGraph(
    Graphs=construct_graph_4.Graphs,
    PreviewColor=RGB(0, 100, 0),
    ShowNodeValence=True,
    ShowEdgeValence=False,
    ShowNodeProperties=False,
    ShowNodeAttribute=False,
    ShowEdgeAsArc=True)

# ----
# Export graph to JSON
panel_9 = Panel("E:\Desktop\Graph.JSON")
export_graph_to_json = ExportGraphToJSON(Graph=[construct_graph_5.Graphs, construct_graph_6.Graphs], FilePath=panel_9, IncludeGeometry=True, Export=Button())
panel_10 = Panel(export_graph_to_json)

# ----
# Find closest graph
point_10 = Point(<point referenced from the Rhino model>)
find_closest_graph = FindClosestGraph(Graphs=[construct_graph_5.Graphs, construct_graph_6.Graphs], TestPoints=point_10)  # -> ClosestGraphs, Distances

# ----
# Create a graph
# from edge only
construct_graph_7 = ConstructGraph(Edges=construct_edge, ShatterEdge=True)  # -> Graphs, IsolatedNodes, IsolatedEdges

visualize_graph_2 = VisualizeGraph(
    Graphs=construct_graph_2.Graphs,
    PreviewColor=RGB(0, 100, 0),
    ShowNodeValence=True,
    ShowEdgeValence=False,
    ShowNodeProperties=False,
    ShowNodeAttribute=False,
    ShowEdgeAsArc=True)
visualize_graph_3 = VisualizeGraph(
    Graphs=modifygraphelement,
    PreviewColor=ColourSwatch(SwatchColor=RGB(0, 64, 255)),
    ShowNodeValence=True,
    ShowEdgeValence=False,
    ShowNodeProperties=False,
    ShowNodeAttribute=False,
    ShowEdgeAsArc=True)

# ----
# Deconstruct
# graph data
deconstruct_graph_4 = DeconstructGraph(Graph=modifygraphelement)  # -> Properties, Nodes, Edges, Attributes
panel_11 = Panel(deconstruct_graph_4.Attributes)
panel_12 = Panel(deconstruct_graph_4.Properties)
deconstruct_node_4 = DeconstructNode(Node=deconstruct_graph_4.Nodes)  # -> Properties, Point, LinkedObjects, Attributes
deconstruct_edge_2 = DeconstructEdge(Edge=deconstruct_graph_4.Edges)  # -> Properties, SourceNode, TargetNode, Geometry, LinkedObjects, Attributes
panel_13 = Panel(deconstruct_node_4.Properties)
panel_14 = Panel(deconstruct_edge_2.Properties)

point_11 = Point([<point referenced from the Rhino model> x4])
visualize_graph_4 = VisualizeGraph(
    Graphs=connect_node_to_graph,
    PreviewColor=RGB(0, 100, 0),
    ShowNodeValence=invert(True),
    ShowEdgeValence=invert(False),
    ShowNodeProperties=invert(False),
    ShowNodeAttribute=False,
    ShowEdgeAsArc=True)
visualize_graph_5 = VisualizeGraph(
    Graphs=find_closest_graph.ClosestGraphs,
    PreviewColor=RGB(0, 100, 0),
    ShowNodeValence=True,
    ShowEdgeValence=False,
    ShowNodeProperties=False,
    ShowNodeAttribute=False,
    ShowEdgeAsArc=True)
construct_node_10 = ConstructNode(Points=point_11)

# ----
# Find and modify
# edge attribute
curve_7 = Curve(<curve referenced from the Rhino model>)
serialize_keys_and_values_5 = SerializeKeysAndValues(Key="KeyTest", Value="ValueTest")
find_modify_graph_edge = FindModifyGraphEdge(Graphs=modifygraphelement, Lines=curve_7, TypeToChange="C", AttributesToChange=serialize_keys_and_values_5)  # -> UpdatedGraphs, UpdatedEdges
deconstruct_edge_3 = DeconstructEdge(Edge=find_modify_graph_edge.UpdatedEdges)  # -> Properties, SourceNode, TargetNode, Geometry, LinkedObjects, Attributes
panel_15 = Panel(deconstruct_edge_3.Attributes)
panel_16 = Panel(deconstruct_edge_3.Properties)

# ----
# Split graph into
# subgraphs at point
point_12 = Point(<point referenced from the Rhino model>)
splitgraphatpoint = SplitGraphAtPoint(Graphs=find_modify_graph_edge.UpdatedGraphs, Points=point_12)
list_item = ListItem(List=splitgraphatpoint, Index=Slider(1, range=0..10), Wrap=True)
serialize_keys_and_values_6 = SerializeKeysAndValues(Key="KeyTest", Value="ValueTest")
find_modify_graph_node = FindModifyGraphNode(Graphs=list_item, Points=point_12, AttributesToChange=serialize_keys_and_values_6)  # -> UpdatedGraphs, UpdatedNodes

visualize_graph_6 = VisualizeGraph(
    Graphs=find_modify_graph_node.UpdatedGraphs,
    PreviewColor=RGB(0, 100, 0),
    ShowNodeValence=True,
    ShowEdgeValence=False,
    ShowNodeProperties=False,
    ShowNodeAttribute=invert(False),
    ShowEdgeAsArc=True)

# ----
# Filter node by properties
number_slider = Slider(1, range=0..10)
integer = Integer(number_slider)
serialize_keys_and_values_7 = SerializeKeysAndValues(Key="Valence", Value=integer)
panel_17 = Panel(serialize_keys_and_values_7)
panel_18 = Panel(serialize_keys_and_values_6)
filter_node_and_edge = FilterNodeAndEdge(Graphs=find_modify_graph_node.UpdatedGraphs, Properties=panel_17, Attributes=panel_18)  # -> FilteredNodes, FilteredEdges
deconstruct_node_5 = DeconstructNode(Node=filter_node_and_edge.FilteredNodes)  # -> Properties, Point, LinkedObjects, Attributes
panel_19 = Panel([deconstruct_node_5.Properties, deconstruct_node_5.Attributes])

# ----
# Filter edge by type
panel_20 = Panel("unset")
filter_node_and_edge_2 = FilterNodeAndEdge(Graphs=find_modify_graph_node.UpdatedGraphs, Type="C")  # -> FilteredNodes, FilteredEdges
filter_node_and_edge_3 = FilterNodeAndEdge(Graphs=find_modify_graph_node.UpdatedGraphs, Type=panel_20)  # -> FilteredNodes, FilteredEdges
deconstruct_edge_4 = DeconstructEdge(Edge=filter_node_and_edge_2.FilteredEdges)  # -> Properties, SourceNode, TargetNode, Geometry, LinkedObjects, Attributes
deconstruct_edge_5 = DeconstructEdge(Edge=filter_node_and_edge_3.FilteredEdges)  # -> Properties, SourceNode, TargetNode, Geometry, LinkedObjects, Attributes
panel_21 = Panel(deconstruct_edge_4.Properties)
panel_22 = Panel(deconstruct_edge_5.Properties)

# ----
# Shortest path
number_slider_2 = Slider(4, range=0..10)
rectangular = Rectangular(Plane=PlaneXY(317.6524037, 61.23681872, 0), SizeX=number_slider_2, SizeY=number_slider_2, ExtentX=10, ExtentY=5)  # -> Cells, Points
explode = Explode(Curve=flatten(rectangular.Cells), Recursive=True)  # -> Segments, Vertices
remove_duplicate_lines_karamba3d = RemoveDuplicateLinesKaramba3D(Line=flatten(explode.Segments), LimitDistance=0.005)  # -> OutLine, Info, Indexes
construct_edge_7 = ConstructEdge(Curves=remove_duplicate_lines_karamba3d.OutLine)
point_13 = Point(<point referenced from the Rhino model>)
point_14 = Point(<point referenced from the Rhino model>)

construct_graph_8 = ConstructGraph(Edges=construct_edge_7, ShatterEdge=True)  # -> Graphs, IsolatedNodes, IsolatedEdges

find_modify_graph_node_2 = FindModifyGraphNode(Graphs=construct_graph_8.Graphs, Points=[point_14, point_13])  # -> UpdatedGraphs, UpdatedNodes
list_item_2 = ListItem(List=find_modify_graph_node_2.UpdatedNodes, Index=0, Wrap=True)  # -> Item, Item1
list_item_3 = ListItem(List=find_modify_graph_node_2.UpdatedNodes, Index=0, Wrap=True)  # -> Item, Item1
merge_2 = Merge(Data1=list_item_3.Item, Data2=list_item_3.Item1)
merge_3 = Merge(Data1=list_item_2.Item1, Data2=list_item_2.Item)
longest_list_3 = LongestList(ListListA=construct_graph_8.Graphs, ListListB=merge_2, ListA=merge_3, PaddingMode=2)  # -> graft(ListListA), graft(ListListB), graft(ListA)
find_shortest_path = FindShortestPath(Graphs=longest_list_3.ListListA, StartNodes=longest_list_3.ListListB, EndNodes=longest_list_3.ListA)  # -> PathNodes, PathEdges, PathLength
panel_23 = Panel(find_shortest_path.PathLength)
deconstruct_edge_6 = DeconstructEdge(Edge=find_shortest_path.PathEdges)  # -> Properties, SourceNode, TargetNode, Geometry, LinkedObjects, Attributes
panel_24 = Panel(deconstruct_edge_6.Geometry)
custom_preview_lineweights = CustomPreviewLineweights(
    Geometry=deconstruct_edge_6.Geometry,
    Shader={diffuse=RGB(255, 105, 180), emission=RGB(76, 32, 54), shine=0.5, specular=RGB(255, 255, 255), transparency=0},
    Thickness=Slider(7, range=0..10),
    Absolute=False)

# ----
# Skeleton graph from 2D boundary -> Prune -> Simplify
curve_8 = Curve([<curve referenced from the Rhino model> x3])
point_15 = Point([<point referenced from the Rhino model> x2])
integer_2 = Integer(Slider(1, range=0..10))
serialize_keys_and_values_8 = SerializeKeysAndValues(Key="Valence", Value=integer_2)
panel_25 = Panel(serialize_keys_and_values_8)

skeletonize_boundary = SkeletonizeBoundary(BoundaryCurve=curve_8, DivisionLength=Slider(3, range=0..10))  # -> SkeletonCurves, SkeletonGraphs, UniqueLines

find_modify_graph_node_3 = FindModifyGraphNode(Graphs=skeletonize_boundary.SkeletonGraphs, Points=point_15, Type="NoPrune")  # -> UpdatedGraphs, UpdatedNodes
filter_node_and_edge_4 = FilterNodeAndEdge(Graphs=find_modify_graph_node_3.UpdatedGraphs, Type="NoPrune", Properties=panel_25)  # -> FilteredNodes, FilteredEdges
prune_graph_node = PruneGraphNode(Graphs=find_modify_graph_node_3.UpdatedGraphs, ValenceToPrune=1, TypeToExclude="NoPrune", PruneTypeUnsetOnly=True)
deconstruct_node_6 = DeconstructNode(Node=filter_node_and_edge_4.FilteredNodes)  # -> Properties, Point, LinkedObjects, Attributes
panel_26 = Panel(deconstruct_node_6.Properties)
simplify_graph = SimplifyGraph(
    Graphs=prune_graph_node,
    MinAngle=Slider(156, range=0..1000),
    MaxAngle=180,
    CollapseShortEdges=invert(False),
    MinLength=Slider(2, range=0..10))

connect_node_to_graph_2 = ConnectNodeToGraph(Graphs=simplify_graph, Nodes=construct_node_10)
visualize_graph_7 = VisualizeGraph(
    Graphs=connect_node_to_graph_2,
    PreviewColor=RGB(0, 100, 0),
    ShowNodeValence=True,
    ShowEdgeValence=False,
    ShowNodeProperties=False,
    ShowNodeAttribute=False,
    ShowEdgeAsArc=invert(True))

# ----
# Find node by Point
# and add Type & Attribute
panel_27 = Panel("NodeAttribute2")
point_16 = Point([<point referenced from the Rhino model> x2])
serialize_keys_and_values_9 = SerializeKeysAndValues(Key="KeyNode2", Value=panel_27)

find_modify_graph_node_4 = FindModifyGraphNode(Graphs=construct_graph_7.Graphs, Points=point_16, TypeToChange="A", AttributesToChange=serialize_keys_and_values_9)  # -> UpdatedGraphs, UpdatedNodes

deconstruct_node_7 = DeconstructNode(Node=find_modify_graph_node_4.UpdatedNodes)  # -> Properties, Point, LinkedObjects, Attributes
panel_28 = Panel(deconstruct_node_7.Properties)

visualize_graph_8 = VisualizeGraph(
    Graphs=find_modify_graph_node_4.UpdatedGraphs,
    PreviewColor=ColourSwatch(SwatchColor=RGB(255, 229, 0)),
    ShowNodeValence=True,
    ShowEdgeValence=False,
    ShowNodeProperties=False,
    ShowNodeAttribute=False,
    ShowEdgeAsArc=True)

# ----
# Merge connected graph
merge_4 = Merge(Data1=modifygraphelement, Data2=find_modify_graph_node_4.UpdatedGraphs)  # -> flatten(Result)
curve_9 = Curve(<curve referenced from the Rhino model>)
construct_edge_8 = ConstructEdge(Curves=curve_9)
merge_graphs = MergeGraphs(Graphs=merge_4, AdditionalEdges=construct_edge_8)  # -> MergedGraphs, IsolatedNodes, IsolatedEdges
deconstruct_graph_5 = DeconstructGraph(Graph=merge_graphs.MergedGraphs)  # -> Properties, Nodes, Edges, Attributes
panel_29 = Panel(deconstruct_graph_5.Properties)
deconstruct_node_8 = DeconstructNode(Node=deconstruct_graph_5.Nodes)  # -> Properties, Point, LinkedObjects, Attributes
panel_30 = Panel(deconstruct_node_8.Properties)

visualize_graph_9 = VisualizeGraph(
    Graphs=merge_graphs.MergedGraphs,
    PreviewColor=ColourSwatch(SwatchColor=RGB(255, 0, 0)),
    ShowNodeValence=True,
    ShowEdgeValence=False,
    ShowNodeProperties=False,
    ShowNodeAttribute=False,
    ShowEdgeAsArc=True)
